test file "HighwayLaneFollowingTestAssessments"

suite "Test Scenarios"

  case "scenario_LFACC_01_Curve_DecelTarget" [simulation]
    model HighwayLaneFollowingTestBench
    pre-load callback:
      assignin('base','cameraOutputFileDir',pwd);
    post-load callback:
      scenarioName = "scenario_LFACC_01_Curve_DecelTarget";
      helperSLHighwayLaneFollowingSetup("scenarioFcnName",scenarioName);
      % Configure output video file name
      cameraOutputFileDir = evalin('base','cameraOutputFileDir');
      set_param("HighwayLaneFollowingTestBench/Simulation 3D Scenario/To Multimedia File",...
          'outputFilename', cameraOutputFileDir+"/"+scenarioName+'.mp4');
    cleanup callback:
      %Generate Plots & update test result description.
      testCaseID = 1;
      results = sltest.testmanager.getResultSets;
      helperTMTestCasePostProcessing(sltest_simout.logsout,results,sltest_testCase,testCaseID);
    custom criteria:
      %Verify Precision and Sensitivity for Lane Detector
      % Thresholds for precision and sensitivity
      precisionThreshold = 90;
      sensitivityThreshold = 90;
      % Verify if the precision and sensitivity are greater than the thresholds
      helperVerifyPrecisionAndSensitivity(test,precisionThreshold,sensitivityThreshold);

      %Verify Precision and Missrate for Vision Vehicle Detector
      % Thresholds for precision and missrate
      precisionThreshold = 0.80;
      missrateThreshold = 0.25;
      % Verify precision and missrate
      helperVerifyPrecisionAndMissrate(test,precisionThreshold,missrateThreshold);

  case "scenario_LFACC_02_Curve_AutoRetarget" [simulation]
    model HighwayLaneFollowingTestBench
    pre-load callback:
      assignin('base','cameraOutputFileDir',pwd);
    post-load callback:
      scenarioName = "scenario_LFACC_02_Curve_AutoRetarget";
      helperSLHighwayLaneFollowingSetup("scenarioFcnName",scenarioName);
      % Configure output video file name
      cameraOutputFileDir = evalin('base','cameraOutputFileDir');
      set_param("HighwayLaneFollowingTestBench/Simulation 3D Scenario/To Multimedia File",...
          'outputFilename', cameraOutputFileDir+"/"+scenarioName+'.mp4');
    cleanup callback:
      %Generate Plots & update test result description.
      testCaseID = 2;
      results = sltest.testmanager.getResultSets;
      helperTMTestCasePostProcessing(sltest_simout.logsout,results,sltest_testCase,testCaseID);
    custom criteria: same code as in custom criteria of case "scenario_LFACC_01_Curve_DecelTarget"

  case "scenario_LFACC_03_Curve_StopnGo" [simulation]
    model HighwayLaneFollowingTestBench
    pre-load callback:
      assignin('base','cameraOutputFileDir',pwd);
    post-load callback:
      scenarioName = "scenario_LFACC_03_Curve_StopnGo";
      helperSLHighwayLaneFollowingSetup("scenarioFcnName",scenarioName);
      % Configure output video file name
      cameraOutputFileDir = evalin('base','cameraOutputFileDir');
      set_param("HighwayLaneFollowingTestBench/Simulation 3D Scenario/To Multimedia File",...
          'outputFilename', cameraOutputFileDir+"/"+scenarioName+'.mp4');
    cleanup callback:
      %Generate Plots & update test result description.
      testCaseID = 3;
      results = sltest.testmanager.getResultSets;
      helperTMTestCasePostProcessing(sltest_simout.logsout,results,sltest_testCase,testCaseID);
    custom criteria: same code as in custom criteria of case "scenario_LFACC_01_Curve_DecelTarget"

  case "scenario_LFACC_04_Curve_CutInOut" [simulation]
    model HighwayLaneFollowingTestBench
    pre-load callback:
      assignin('base','cameraOutputFileDir',pwd);
    post-load callback:
      scenarioName = "scenario_LFACC_04_Curve_CutInOut";
      helperSLHighwayLaneFollowingSetup("scenarioFcnName",scenarioName);
      % Configure output video file name
      cameraOutputFileDir = evalin('base','cameraOutputFileDir');
      set_param("HighwayLaneFollowingTestBench/Simulation 3D Scenario/To Multimedia File",...
          'outputFilename', cameraOutputFileDir+"/"+scenarioName+'.mp4');
    cleanup callback:
      %Generate Plots & update test result description.
      testCaseID = 4;
      results = sltest.testmanager.getResultSets;
      helperTMTestCasePostProcessing(sltest_simout.logsout,results,sltest_testCase,testCaseID);
    custom criteria: same code as in custom criteria of case "scenario_LFACC_01_Curve_DecelTarget"

  case "scenario_LFACC_05_Curve_CutInOut_TooClose" [simulation]
    model HighwayLaneFollowingTestBench
    pre-load callback:
      assignin('base','cameraOutputFileDir',pwd);
    post-load callback:
      scenarioName = "scenario_LFACC_05_Curve_CutInOut_TooClose";
      helperSLHighwayLaneFollowingSetup("scenarioFcnName",scenarioName);
      % Configure output video file name
      cameraOutputFileDir = evalin('base','cameraOutputFileDir');
      set_param("HighwayLaneFollowingTestBench/Simulation 3D Scenario/To Multimedia File",...
          'outputFilename', cameraOutputFileDir+"/"+scenarioName+'.mp4');
    cleanup callback:
      %Generate Plots & update test result description.
      testCaseID = 5;
      results = sltest.testmanager.getResultSets;
      helperTMTestCasePostProcessing(sltest_simout.logsout,results,sltest_testCase,testCaseID);
    custom criteria: same code as in custom criteria of case "scenario_LFACC_01_Curve_DecelTarget"

  case "scenario_LFACC_06_Straight_StopandGoLeadCar" [simulation]
    model HighwayLaneFollowingTestBench
    pre-load callback:
      assignin('base','cameraOutputFileDir',pwd);
    post-load callback:
      scenarioName = "scenario_LFACC_06_Straight_StopandGoLeadCar";
      helperSLHighwayLaneFollowingSetup("scenarioFcnName",scenarioName);
      % Configure output video file name
      cameraOutputFileDir = evalin('base','cameraOutputFileDir');
      set_param("HighwayLaneFollowingTestBench/Simulation 3D Scenario/To Multimedia File",...
          'outputFilename', cameraOutputFileDir+"/"+scenarioName+'.mp4');
    cleanup callback:
      %Generate Plots & update test result description.
      testCaseID = 6;
      results = sltest.testmanager.getResultSets;
      helperTMTestCasePostProcessing(sltest_simout.logsout,results,sltest_testCase,testCaseID);
    custom criteria:
      %Verify Precision and Sensitivity for Lane Detector
      % Thresholds for precision and sensitivity
      precisionThreshold = 90;
      sensitivityThreshold = 90;
      % Verify if the precision and sensitivity are greater than the thresholds
      helperVerifyPrecisionAndSensitivity(test,precisionThreshold,sensitivityThreshold);

      %Verify Precision and Missrate for Vision Vehicle Detector
      % Thresholds for precision and missrate.
      % In this scenario, the lead vehicle suddenly comes in sensor range of a fast moving ego vehicle and
      % hence a low precision and high missrate values are expected.
      precisionThreshold = 0.45;
      missrateThreshold = 0.55;
      % Verify precision and missrate
      helperVerifyPrecisionAndMissrate(test,precisionThreshold,missrateThreshold);

  case "scenario_LF_01_Straight_RightLane" [simulation]
    model HighwayLaneFollowingTestBench
    pre-load callback:
      assignin('base','cameraOutputFileDir',pwd);
    post-load callback:
      scenarioName = "scenario_LF_01_Straight_RightLane";
      helperSLHighwayLaneFollowingSetup("scenarioFcnName",scenarioName);
      % Configure output video file name
      cameraOutputFileDir = evalin('base','cameraOutputFileDir');
      set_param("HighwayLaneFollowingTestBench/Simulation 3D Scenario/To Multimedia File",...
          'outputFilename', cameraOutputFileDir+"/"+scenarioName+'.mp4');
    cleanup callback:
      %Generate Plots & update test result description.
      testCaseID = 7;
      results = sltest.testmanager.getResultSets;
      helperTMTestCasePostProcessing(sltest_simout.logsout,results,sltest_testCase,testCaseID);
    custom criteria:
      %Verify Precision and Sensitivity for Lane Detector
      % Thresholds for precision and sensitivity
      precisionThreshold = 90;
      sensitivityThreshold = 90;
      % Verify if the precision and sensitivity are greater than the thresholds
      helperVerifyPrecisionAndSensitivity(test,precisionThreshold,sensitivityThreshold);

  case "scenario_LF_02_Straight_LeftLane" [simulation]
    model HighwayLaneFollowingTestBench
    pre-load callback:
      assignin('base','cameraOutputFileDir',pwd);
    post-load callback:
      scenarioName = "scenario_LF_02_Straight_LeftLane";
      helperSLHighwayLaneFollowingSetup("scenarioFcnName",scenarioName);
      % Configure output video file name
      cameraOutputFileDir = evalin('base','cameraOutputFileDir');
      set_param("HighwayLaneFollowingTestBench/Simulation 3D Scenario/To Multimedia File",...
          'outputFilename', cameraOutputFileDir+"/"+scenarioName+'.mp4');
    cleanup callback:
      %Generate Plots & update test result description.
      testCaseID = 8;
      results = sltest.testmanager.getResultSets;
      helperTMTestCasePostProcessing(sltest_simout.logsout,results,sltest_testCase,testCaseID);
    custom criteria: same code as in custom criteria of case "scenario_LF_01_Straight_RightLane"

  case "scenario_LF_03_Curve_LeftLane" [simulation]
    model HighwayLaneFollowingTestBench
    pre-load callback:
      assignin('base','cameraOutputFileDir',pwd);
    post-load callback:
      scenarioName = "scenario_LF_03_Curve_LeftLane";
      helperSLHighwayLaneFollowingSetup("scenarioFcnName",scenarioName);
      % Configure output video file name
      cameraOutputFileDir = evalin('base','cameraOutputFileDir');
      set_param("HighwayLaneFollowingTestBench/Simulation 3D Scenario/To Multimedia File",...
          'outputFilename', cameraOutputFileDir+"/"+scenarioName+'.mp4');
    cleanup callback:
      %Generate Plots & update test result description.
      testCaseID = 9;
      results = sltest.testmanager.getResultSets;
      helperTMTestCasePostProcessing(sltest_simout.logsout,results,sltest_testCase,testCaseID);
    custom criteria: same code as in custom criteria of case "scenario_LF_01_Straight_RightLane"

  case "scenario_LF_04_Curve_RightLane" [simulation]
    model HighwayLaneFollowingTestBench
    pre-load callback:
      assignin('base','cameraOutputFileDir',pwd);
    post-load callback:
      scenarioName = "scenario_LF_04_Curve_RightLane";
      helperSLHighwayLaneFollowingSetup("scenarioFcnName",scenarioName);
      % Configure output video file name
      cameraOutputFileDir = evalin('base','cameraOutputFileDir');
      set_param("HighwayLaneFollowingTestBench/Simulation 3D Scenario/To Multimedia File",...
          'outputFilename', cameraOutputFileDir+"/"+scenarioName+'.mp4');
    cleanup callback:
      %Generate Plots & update test result description.
      testCaseID = 10;
      results = sltest.testmanager.getResultSets;
      helperTMTestCasePostProcessing(sltest_simout.logsout,results,sltest_testCase,testCaseID);
    custom criteria: same code as in custom criteria of case "scenario_LF_01_Straight_RightLane"